# Grasshopper definition handlesGenerator.gh (Grasshopper 1.0.8)
# plug-ins: Pufferfish

panel = Panel("""100
-100""")
Y = UnitY(Factor=panel)
Z = UnitZ(Factor=panel)
X = UnitX(Factor=panel)
geo = Geometry([<extrusion referenced from the Rhino model>, <brep referenced from the Rhino model>, <extrusion referenced from the Rhino model>, <brep referenced from the Rhino model> x8])
pt = Point([<point referenced from the Rhino model> x11])
merge = Merge(Data1=X, Data2=Z, Data3=Y)
pt_2 = Point(Point(0, 0, 0))
move = Move(Geometry=pt_2, Motion=merge)  # -> Geometry, Transform
pt_3 = Point(Point(0, 0, 0))
move2pt = MoveToPoint(Geometry=geo, PointA=pt, PointB=pt_3)  # -> Moved, Vector, Transform
move2pt_2 = MoveToPoint(Geometry=geo, PointA=pt, PointB=graft(move.Geometry))  # -> simplify(Moved), Vector, Transform
viewer = ParamViewer(move2pt_2.Moved)
panel_2 = Panel("""90
180
270""")
rotate = Rotate(Geometry=graft(move2pt.Moved), Angle=degrees(panel_2), Plane=pt_3)  # -> Geometry, Transform
viewer_2 = ParamViewer(rotate.Geometry)
branch = TreeBranch(Tree=move2pt_2.Moved, Path=Slider(0, range=0..100), MaintainPaths=True)
item = ListItem(List=branch, Index=Slider(3, range=0..3), Wrap=True)
merge_2 = Merge(Data1=graft(move2pt.Moved), Data2=rotate.Geometry)  # -> simplify(Result)
branch_2 = TreeBranch(Tree=merge_2, Path=Slider(1, range=0..100), MaintainPaths=True)
item_2 = ListItem(List=branch_2, Index=Slider(3, range=0..3), Wrap=True)
